# Grasshopper definition BRICK WALL.gh (Grasshopper 1.0.8)

długość_ściany = Slider(1000, range=0..1000)
szerokość_cegły = Slider(6.5, range=0..10)
ilość_rzędów = Slider(30, range=0..100)
ilość_rzędów_2 = Slider(31, range=0..100)
pt = ConstructPoint(XCoordinate=0, YCoordinate=0, ZCoordinate=0)
X = UnitX(Factor=1)
line = LineSDL(Start=pt, Direction=X, Length=długość_ściany)
series = Series(Start=0, Step=szerokość_cegły, Count=ilość_rzędów)
Z = UnitZ(Factor=series)
series_2 = Series(Start=0, Step=Slider(1, range=0..1), Count=ilość_rzędów_2)
number_slider = Slider(12.5, range=0..100)
move = Move(Geometry=line, Motion=Z)  # -> Geometry, Transform
expression = Expression(x=series_2, y=number_slider, Expression="x % 2")
X_2 = UnitX(Factor=1)
multiplication = Multiplication(A=expression, B=number_slider)
amp = Amplitude(Vector=X_2, Amplitude=multiplication)
move_2 = Move(Geometry=move.Geometry, Motion=amp)  # -> Geometry, Transform
X_3 = UnitX(Factor=1)
divlength = DivideLength(Curve=move_2.Geometry, Length=Slider(25, range=0..100))  # -> Points, Tangents, Parameters
amp_2 = Amplitude(Vector=X_3, Amplitude=Slider(12.5, range=0..100))
move_3 = Move(Geometry=divlength.Points, Motion=amp_2)  # -> Geometry, Transform
panel = Panel(" punkty środkowe cegieł")
crv = Curve(<curve referenced from the Rhino model>)
pt_2 = Point(move_3.Geometry)
crv_cp = CurveClosestPoint(Point=move_3.Geometry, Curve=crv)  # -> Point, Parameter, Distance
Z_2 = UnitZ(Factor=1)
pl = PlaneNormal(Origin=pt_2, ZAxis=Z_2)
bnd = Bounds(Numbers=crv_cp.Distance)
dom = ConstructDomain(DomainStart=Slider(0, range=0..100), DomainEnd=Slider(1, range=0..100))
dom_2 = ConstructDomain(DomainStart=Slider(12.5, range=0..100), DomainEnd=Slider(-12.5, range=-15..-11.5))
dom_3 = ConstructDomain(DomainStart=Slider(6, range=0..100), DomainEnd=Slider(-6, range=-15..0))
remap = RemapNumbers(Value=crv_cp.Distance, Source=bnd, Target=dom)  # -> Mapped, Clipped
rectangle = Rectangle(Plane=pl, XSize=dom_2, YSize=dom_3, Radius=0)  # -> Rectangle, Length
multiplication_2 = Multiplication(A=remap.Mapped, B=Slider(45, range=0..100))
rad = Radians(Degrees=multiplication_2)
expression_2 = Expression(x=remap.Mapped, Expression="1 + x * 0.6")
rotate = Rotate(Geometry=rectangle.Rectangle, Angle=rad, Plane=pt_2)  # -> Geometry, Transform
scale_nu = ScaleNU(Geometry=rotate.Geometry, Plane=pt_2, ScaleX=expression_2, ScaleY=Slider(1, range=0..1), ScaleZ=Slider(1, range=0..1))  # -> Geometry, Transform
Z_3 = UnitZ(Factor=1)
boundary = BoundarySurfaces(Edges=scale_nu.Geometry)
amp_3 = Amplitude(Vector=Z_3, Amplitude=Slider(6.5, range=0..10))
extr = Extrude(Base=boundary, Direction=amp_3)
cap = CapHoles(Brep=extr)
