# Grasshopper definition PARAMETRIC CANOPY.gh (Grasshopper 1.0.8)

number_slider = Slider(8, range=0..150)
panel = Panel(" Poliline B")
# n = 8 number of segments
# 
# heightFactor = 1 height multiplier
# 
# twist = 25 profile twist in degrees
# 
# thickness = 0.05 optional surface thickness
panel_2 = Panel(" Poliline A")
crv = Curve(<curve referenced from the Rhino model>)
crv_2 = Curve(<curve referenced from the Rhino model>)
divide = DivideCurve(Curve=crv_2, Count=number_slider, Kinks=False)  # -> Points, Tangents, Parameters
divide_2 = DivideCurve(Curve=crv, Count=number_slider, Kinks=False)  # -> Points, Tangents, Parameters
ln = Line(StartPoint=divide.Points, EndPoint=divide_2.Points)
len = Length(Curve=ln)
eval = EvaluateCurve(Curve=reparameterize(ln), Parameter=Slider(0.5, range=0..1))  # -> Point, Tangent, Angle
Z = UnitZ(Factor=1)
amp = Amplitude(Vector=Z, Amplitude=len)
move = Move(Geometry=eval.Point, Motion=amp)  # -> Geometry, Transform

cull_i = CullIndex(List=divide_2.Points, Indices=Slider(9, range=0..150), Wrap=True)
cull_i_2 = CullIndex(List=divide_2.Points, Indices=Slider(0, range=0..150), Wrap=True)
cull_i_3 = CullIndex(List=move.Geometry, Indices=Slider(8, range=0..150), Wrap=True)
cull_i_4 = CullIndex(List=move.Geometry, Indices=Slider(0, range=0..150), Wrap=True)
panel_3 = Panel("RIGHT SPACE")
srf4pt = _4PointSurface(CornerA=cull_i_2, CornerB=cull_i_4, CornerC=cull_i_3, CornerD=cull_i)

cull_i_5 = CullIndex(List=divide.Points, Indices=Slider(9, range=0..150), Wrap=True)
cull_i_6 = CullIndex(List=divide.Points, Indices=Slider(0, range=0..150), Wrap=True)
cull_i_7 = CullIndex(List=move.Geometry, Indices=Slider(0, range=0..150), Wrap=True)
cull_i_8 = CullIndex(List=move.Geometry, Indices=Slider(8, range=0..150), Wrap=True)
srf4pt_2 = _4PointSurface(CornerA=flatten(cull_i_6), CornerB=flatten(cull_i_7), CornerC=flatten(cull_i_8), CornerD=flatten(cull_i_5))

merge = Merge(Data1=graft(divide.Points), Data2=graft(move.Geometry), Data3=graft(divide_2.Points))
