# Grasshopper definition TRUSS.gh (Grasshopper 1.0.8)

# ----
# L = 24.0 bridge length
# 
# N = 6 number of truss panels
# 
# H = 3.0 bridge height (i.e., 300 cm)
# 
# W = 4.0 bridge width (i.e., 400 cm)
# 
# pipeR = 0.08 member thickness
number_slider = Slider(0, range=0..100)
number_slider_2 = Slider(6, range=0..10)
X = UnitX(Factor=1)
pt = ConstructPoint(XCoordinate=number_slider, YCoordinate=number_slider, ZCoordinate=number_slider)
line = LineSDL(Start=pt, Direction=X, Length=Slider(24, range=0..100))

divide = DivideCurve(Curve=line, Count=number_slider_2, Kinks=False)  # -> Points, Tangents, Parameters
Z = UnitZ(Factor=1)
panel = Panel(divide.Points)
amp = Amplitude(Vector=Z, Amplitude=Slider(3, range=0..10))
move = Move(Geometry=line, Motion=amp)  # -> Geometry, Transform
divide_2 = DivideCurve(Curve=move.Geometry, Count=number_slider_2, Kinks=False)  # -> Points, Tangents, Parameters

Y = UnitY(Factor=Slider(4, range=0..10))
move_2 = Move(Geometry=divide_2.Points, Motion=Y)  # -> Geometry, Transform
ln = Line(StartPoint=move_2.Geometry, EndPoint=divide_2.Points)
pipe = Pipe(Curve=ln, Radius=Slider(0.1, range=0..0.1), Caps=2, FitRail=False)

cull_i = CullIndex(List=move_2.Geometry, Indices=Slider(0, range=0..10), Wrap=True)
Y_2 = UnitY(Factor=Slider(0, range=0..10))
move_3 = Move(Geometry=divide_2.Points, Motion=Y_2)  # -> Geometry, Transform
ln_2 = Line(StartPoint=cull_i, EndPoint=move_3.Geometry)
pipe_2 = Pipe(Curve=ln_2, Radius=Slider(0.1, range=0..0.1), Caps=2, FitRail=False)

cull_i_2 = CullIndex(List=divide_2.Points, Indices=Slider(0, range=0..10), Wrap=True)
Y_3 = UnitY(Factor=Slider(0, range=0..10))
move_4 = Move(Geometry=move_2.Geometry, Motion=Y_3)  # -> Geometry, Transform
ln_3 = Line(StartPoint=cull_i_2, EndPoint=move_4.Geometry)
pipe_3 = Pipe(Curve=ln_3, Radius=Slider(0.1, range=0..0.1), Caps=2, FitRail=False)

ln_4 = Line(StartPoint=divide_2.Points, EndPoint=divide.Points)
cull_i_3 = CullIndex(List=divide.Points, Indices=Slider(6, range=0..10), Wrap=True)
cull_i_4 = CullIndex(List=divide_2.Points, Indices=Slider(0, range=0..10), Wrap=True)
ln_5 = Line(StartPoint=cull_i_4, EndPoint=cull_i_3)

Y_4 = UnitY(Factor=1)
amp_2 = Amplitude(Vector=Y_4, Amplitude=Slider(4, range=0..10))
merge = Merge(
    Data1=ln_5,
    Data2=divide_2.Points,
    Data3=cull_i_3,
    Data4=divide.Points,
    Data5=line,
    Data6=move.Geometry,
    Data7=amp,
    Data8=ln_4)
move_5 = Move(Geometry=merge, Motion=amp_2)  # -> Geometry, Transform
pipe_4 = Pipe(Curve=move_5.Geometry, Radius=Slider(0.1, range=0..0.1), Caps=2, FitRail=False)
pipe_5 = Pipe(Curve=merge, Radius=Slider(0.1, range=0..0.1), Caps=2, FitRail=False)
